# Dynamo graph PlaceBeams.dyn (Dynamo 2.1.0.7500)

code_block = CodeBlock { 0; 1000; 2000; 3000; 4000; }
byCoordinates = Point.ByCoordinates(x=code_block.out0, y=code_block.out4)
byCoordinates_2 = Point.ByCoordinates(x=code_block.out1, y=code_block.out1, z=code_block.out0)
byCoordinates_3 = Point.ByCoordinates(x=code_block.out2, y=code_block.out3, z=code_block.out4)
list_create = List.Create(item0=byCoordinates, item1=byCoordinates_2, item2=byCoordinates_3)
code_block_2 = CodeBlock { 5000; 6000; 7000; 8000; }
byCoordinates_4 = Point.ByCoordinates(x=code_block_2.out3, y=code_block_2.out0, z=code_block_2.out0)
byCoordinates_5 = Point.ByCoordinates(x=code_block_2.out1, y=code_block_2.out2, z=code_block_2.out1)
byCoordinates_6 = Point.ByCoordinates(x=code_block_2.out3, y=code_block_2.out2, z=code_block_2.out1)
list_create_2 = List.Create(item0=byCoordinates_4, item1=byCoordinates_5, item2=byCoordinates_6)
byStartPointEndPoint = Line.ByStartPointEndPoint(startPoint=list_create, endPoint=list_create_2)
levels = Levels("Level 1")
structural_framing_types = StructuralFramingTypes("300 x 600mm")
beamByCurve = StructuralFraming.BeamByCurve(curve=byStartPointEndPoint, level=levels, structuralFramingType=structural_framing_types)
