# Dynamo graph PlaceWall.dyn (Dynamo 2.1.0.7500)

start_X = DoubleInput(0)  # graph input
start_Y = DoubleInput(0)  # graph input
start_Z = DoubleInput(0)
start_point = Point.ByCoordinates(x=start_X, y=start_Y, z=start_Z)
end_X = DoubleInput(0)  # graph input
end_Y = DoubleInput(6000)  # graph input
end_Z = DoubleInput(0)
end_point = Point.ByCoordinates(x=end_X, y=end_Y, z=end_Z)
byStartPointEndPoint = Line.ByStartPointEndPoint(startPoint=start_point, endPoint=end_point)
wall_height = DoubleInput(3000)  # graph input
levels = Levels("Level 1")  # graph input
wallType = StringInput("Generic - 200mm")  # graph input
byName = WallType.ByName(name=wallType)
byCurveAndHeight = Wall.ByCurveAndHeight(curve=byStartPointEndPoint, height=wall_height, level=levels, wallType=byName)
code_block = CodeBlock()
# ---------- code_block.designscript (2 lines) ----------
Start_x
Start_Y;
# ----------------------------------------
