# Dynamo graph PythonScript.dyn (Dynamo 2.1.0.7500)

python_script = Python()  # unwired: IN[0]
# ---------- python_script.python (21 lines) ----------
# Load the Python Standard and DesignScript Libraries
import sys
import clr
clr.AddReference('ProtoGeometry')
clr.AddReference('RevitAPI')
clr.AddReference('RevitServices')

from Autodesk.DesignScript.Geometry import *
from RevitServices.Persistence import DocumentManager
doc = DocumentManager.Instance.CurrentDBDocument


# The inputs to this node will be stored as a list in the IN variables.
dataEnteringNode = IN

# Place your code below this line

# Assign your output to the OUT variable.

# Returns the name of the Revit Document
OUT = doc.Title
# ----------------------------------------
watch = Watch(python_script)
