# Dynamo graph Replace Parameter Values.dyn (Dynamo 2.1.0.7500)

categories = Categories("OST_Windows")  # graph input
all_elements_of_category = ElementsOfCategory(Category=categories)
parameter_name = StringInput("Enter Parameter Name")  # graph input
new_value = StringInput("Enter New Value")  # graph input
python_script = Python(IN[0]=all_elements_of_category, IN[1]=parameter_name, IN[2]=new_value)
# ---------- python_script.python (77 lines) ----------
# Import necessary Revit and Dynamo modules
import clr
clr.AddReference('RevitAPI')
clr.AddReference('RevitAPIUI')
clr.AddReference('RevitServices')
from Autodesk.Revit.DB import *
from RevitServices.Persistence import DocumentManager
from RevitServices.Transactions import TransactionManager
from Autodesk.Revit.UI import TaskDialog, TaskDialogCommonButtons, TaskDialogResult, TaskDialogIcon

clr.AddReference('System.Windows.Forms')
from System.Windows.Forms import Form, TextBox, Label, Button, ComboBox

# Initialize Revit document
doc = DocumentManager.Instance.CurrentDBDocument

# Retrieve all categories from the document
categories = doc.Settings.Categories

# List to store category names
category_names = []

# Iterate over all categories and filter out those that have elements (i.e., categories that are not hidden)
for category in categories:
    category_names.append(category.Name)

# Now, param_name and new_value hold the user input values
# Inputs from Dynamo
elements = UnwrapElement(IN[0])  # All elements of the selected category
param_name = IN[1]
new_value = IN[2]

# List to store IDs of modified elements
modified_ids = []

# Begin a transaction in Revit
TransactionManager.Instance.EnsureInTransaction(doc)

# Iterate through each element
for elem in elements:
    # Get the parameter by name
    param = elem.LookupParameter(param_name)
    
    # Check if the parameter exists and is writable
    if param and param.IsReadOnly == False:
        # Set the new value
        if param.StorageType == StorageType.String:
            param.Set(str(new_value))
        elif param.StorageType == StorageType.Double:
            param.Set(float(new_value))
        elif param.StorageType == StorageType.Integer:
            param.Set(int(new_value))
        
        # Add the element ID to the modified list
        modified_ids.append(elem.Id.IntegerValue)

# Commit the transaction
TransactionManager.Instance.TransactionTaskDone()

# Output the list of modified element IDs# Display the IDs in a TaskDialog
if modified_ids:
    message = "Modified Element IDs:\n" + "\n".join(map(str, modified_ids))
else:
    message = "No elements were modified."

dialog = TaskDialog("Test")
dialog.Title = "Replace Parameter Values"
dialog.MainContent = str(len(modified_ids)) + " Elements were modified. Click OK to continue."
#dialog.MainInstruction = "Click OK to continue"
dialog.CommonButtons = TaskDialogCommonButtons.Ok

# Show the dialog and capture the result (you can check if the user clicked OK)
result = dialog.Show()

OUT = modified_ids  # Optional: You can keep this to output the list in Dynamo as well

TransactionManager.Instance.TransactionTaskDone()  # Commit transaction
# ----------------------------------------
watch = Watch(python_script)
