# Dynamo graph CreateLevels.dyn (Dynamo 2.1.0.7500)

file_path = Filename("..\..\Projects\Scripts\APS\Extract.xlsx")
file_from_path = FileObject(path=file_path)
string = StringInput("Levels")
importExcel = Data.ImportExcel(file=file_from_path, sheetName=string)
watch = Watch(importExcel)
transpose = List.Transpose(lists=watch)
lastItem = List.LastItem(list=transpose)
firstItem = List.FirstItem(list=transpose)
byElevationAndName = Level.ByElevationAndName(elevation=lastItem, name=firstItem)
byLevel = FloorPlanView.ByLevel(level=byElevationAndName)
byLevel_2 = CeilingPlanView.ByLevel(level=byElevationAndName)
byLevel_3 = StructuralPlanView.ByLevel(level=byElevationAndName)
