# Dynamo graph PlaceBeams.dyn (Dynamo 2.1.0.7500)

file_path = Filename("..\..\..\Beams.xlsx")
file_from_path = FileObject(path=file_path)
string = StringInput("Beams")
boolean = BoolSelector(true)
importExcel = Data.ImportExcel(file=file_from_path, sheetName=string, readAsStrings=boolean)
start_point = Python(IN[0]=importExcel)
# ---------- start_point.python (42 lines) ----------
import clr
# Import Revit API
clr.AddReference('RevitAPI')
from Autodesk.Revit.DB import *

clr.AddReference('ProtoGeometry')
from Autodesk.DesignScript.Geometry import Point

# Input: Excel file path, level, and beam type data
excel_data = IN[0]  # Full path to the Excel file
start_point = []
result = ""

#Iterate through the rows in Excel and place beams
for row in range(len(excel_data)):
	try:
		is_available = True
		
		for col in range(len(excel_data[0])):
			if excel_data[row][col] is None:
				is_available = False
				result += str(row)+ " The data is not accuraccy \n"
				break
	
		if is_available:
			startX = float(excel_data[row][0])
			startY = float(excel_data[row][1])
			startZ = float(excel_data[row][2])
			endX = float(excel_data[row][3])
			endY = float(excel_data[row][4])
			endZ = float(excel_data[row][5])
			
			result += str(startX) + ", " + str(startY) + ", " + str(endX) + ", " + str(endY)
			
			start_point.append(Point.ByCoordinates(startX, startY, startZ))

	except Exception as e:
		result += str(e)+ "\n"
		continue
		
#Output: List of created beams
OUT = start_point
# ----------------------------------------
end_point = Python(IN[0]=importExcel)
# ---------- end_point.python (42 lines) ----------
import clr
# Import Revit API
clr.AddReference('RevitAPI')
from Autodesk.Revit.DB import *

clr.AddReference('ProtoGeometry')
from Autodesk.DesignScript.Geometry import Point

# Input: Excel file path, level, and beam type data
excel_data = IN[0]  # Full path to the Excel file
end_point = []
result = ""

#Iterate through the rows in Excel and place beams
for row in range(len(excel_data)):
	try:
		is_available = True
		
		for col in range(len(excel_data[0])):
			if excel_data[row][col] is None:
				is_available = False
				result += str(row)+ " The data is not accuraccy \n"
				break
	
		if is_available:
			startX = float(excel_data[row][0])
			startY = float(excel_data[row][1])
			startZ = float(excel_data[row][2])
			endX = float(excel_data[row][3])
			endY = float(excel_data[row][4])
			endZ = float(excel_data[row][5])
			
			result += str(startX) + ", " + str(startY) + ", " + str(endX) + ", " + str(endY)
			
			end_point.append(Point.ByCoordinates(endX, endY, endZ))

	except Exception as e:
		result += str(e)+ "\n"
		continue
		
#Output: List of created beams
OUT = end_point
# ----------------------------------------
byStartPointEndPoint = Line.ByStartPointEndPoint(startPoint=start_point, endPoint=end_point)
level = StringInput("Level 1")
python_script = Python(IN[0]=level)
# ---------- python_script.python (35 lines) ----------
# Import necessary modules
import clr

# Import Revit Services
clr.AddReference('RevitServices')
from RevitServices.Persistence import DocumentManager

# Import Revit API
clr.AddReference('RevitAPI')
from Autodesk.Revit.DB import FilteredElementCollector, BuiltInCategory, Level

# Get the current Revit document
doc = DocumentManager.Instance.CurrentDBDocument

# Input: Level name to search for
level_name = IN[0]  # Input comes from Dynamo

# Collect all levels in the project
levels_collector = FilteredElementCollector(doc)\
    .OfCategory(BuiltInCategory.OST_Levels)\
    .WhereElementIsNotElementType()

# Find the level by name
matched_level = None

for level in levels_collector:
    if level.Name == level_name:
        matched_level = level
        break

if matched_level is None:
	matched_level = levels_collector.FirstElement()

# Output the matched level or None if not found
OUT = matched_level
# ----------------------------------------
beam_type = StringInput("300 x 600mm")
python_script_2 = Python(IN[0]=beam_type)
# ---------- python_script_2.python (35 lines) ----------
# Load the Python Standard and DesignScript Libraries
import sys
import clr
clr.AddReference('ProtoGeometry')
from Autodesk.DesignScript.Geometry import *

# Import Revit Services
clr.AddReference('RevitServices')
from RevitServices.Persistence import DocumentManager
from RevitServices.Transactions import TransactionManager

# Import Revit API
clr.AddReference('RevitAPI')
from Autodesk.Revit.DB import *
from Autodesk.Revit.Creation import ItemFactoryBase

# Get the current Revit document
doc = DocumentManager.Instance.CurrentDBDocument
uiapp = DocumentManager.Instance.CurrentUIApplication
app = uiapp.Application

# The inputs to this node will be stored as a list in the IN variables.
beam_type_name = IN[0] 

# Get the beam type from the Revit document by name
beam_type = None
beam_types = FilteredElementCollector(doc).OfCategory(BuiltInCategory.OST_StructuralFraming).WhereElementIsElementType()

if beam_type is None:
	beam_type = beam_types.FirstElement()

# Place your code below this line

# Assign your output to the OUT variable.
OUT = beam_type
# ----------------------------------------
beamByCurve = StructuralFraming.BeamByCurve(curve=byStartPointEndPoint, level=python_script, structuralFramingType=python_script_2)
watch = Watch(python_script_2)
watch_2 = Watch(python_script)
watch_3 = Watch(byStartPointEndPoint)
watch_4 = Watch(start_point)
