# Dynamo graph PlaceElectricity.dyn (Dynamo 2.1.0.7500)

file_path = Filename("..\..\..\Extract.xlsx")
file_from_path = FileObject(path=file_path)
string = StringInput("Plumbing")
boolean = BoolSelector(true)
boolean_2 = BoolSelector(false)
importExcel = Data.ImportExcel(file=file_from_path, sheetName=string, readAsStrings=boolean, showExcel=boolean_2)
start_point = Python(IN[0]=importExcel)
# ---------- start_point.python (41 lines) ----------
import clr
# Import Revit API
clr.AddReference('RevitAPI')
from Autodesk.Revit.DB import *

clr.AddReference('ProtoGeometry')
from Autodesk.DesignScript.Geometry import Point

# Input: Excel file path, level, and beam type data
excel_data = IN[0]  # Full path to the Excel file
start_point = []
result = ""

#Iterate through the rows in Excel and place beams
cols = 3
for row in range(len(excel_data)):
	try:
		is_available = True
		
		if row == 0:
			continue
		
		for col in range(cols):
			if excel_data[row][col] is None:
				is_available = False
				result += str(row)+ " The data is not accuraccy \n"
				break
	
		if is_available:
			x = float(excel_data[row][0])
			y = float(excel_data[row][1])
			z = float(excel_data[row][2])
			
			start_point.append(Point.ByCoordinates(x, y, z))

	except Exception as e:
		result += str(e)+ "\n"
		continue
		
#Output: List of created beams
OUT = start_point
# ----------------------------------------
end_point = Python(IN[0]=importExcel)
# ---------- end_point.python (41 lines) ----------
import clr
# Import Revit API
clr.AddReference('RevitAPI')
from Autodesk.Revit.DB import *

clr.AddReference('ProtoGeometry')
from Autodesk.DesignScript.Geometry import Point

# Input: Excel file path, level, and beam type data
excel_data = IN[0]  # Full path to the Excel file
end_point = []
result = ""

#Iterate through the rows in Excel and place beams
cols = 3
for row in range(len(excel_data)):
	try:
		is_available = True
		
		if row == 0 or row == 1:
			continue
		
		for col in range(cols):
			if excel_data[row][col] is None:
				is_available = False
				result += str(row)+ " The data is not accuraccy \n"
				break
	
		if is_available:
			x = float(excel_data[row][0])
			y = float(excel_data[row][1])
			z = float(excel_data[row][2])
			
			end_point.append(Point.ByCoordinates(x, y, z))

	except Exception as e:
		result += str(e)+ "\n"
		continue
		
#Output: List of created beams
OUT = end_point
# ----------------------------------------
byStartPointEndPoint = Line.ByStartPointEndPoint(startPoint=start_point, endPoint=end_point)
watch = Watch(byStartPointEndPoint)
code_block = CodeBlock { 50; }
element_types = ElementTypes("PipingSystemType")
all_elements_of_type = ElementsOfType(element_type=element_types)
code_block_2 = CodeBlock(x=all_elements_of_type) { x[0]; }
level = StringInput("Level 1")
python_script = Python(IN[0]=level)
# ---------- python_script.python (35 lines) ----------
# Import necessary modules
import clr

# Import Revit Services
clr.AddReference('RevitServices')
from RevitServices.Persistence import DocumentManager

# Import Revit API
clr.AddReference('RevitAPI')
from Autodesk.Revit.DB import FilteredElementCollector, BuiltInCategory, Level

# Get the current Revit document
doc = DocumentManager.Instance.CurrentDBDocument

# Input: Level name to search for
level_name = IN[0]  # Input comes from Dynamo

# Collect all levels in the project
levels_collector = FilteredElementCollector(doc)\
    .OfCategory(BuiltInCategory.OST_Levels)\
    .WhereElementIsNotElementType()

# Find the level by name
matched_level = None

for level in levels_collector:
    if level.Name == level_name:
        matched_level = level
        break

if matched_level is None:
	matched_level = levels_collector.FirstElement()

# Output the matched level or None if not found
OUT = matched_level
# ----------------------------------------
watch_2 = Watch(python_script)
element_types_2 = ElementTypes("PipeType")
all_elements_of_type_2 = ElementsOfType(element_type=element_types_2)
code_block_3 = CodeBlock(x=all_elements_of_type_2) { x[0]; }
pipeFromLine = Custom[PipeFromLine](Diameter=code_block, SystemType=code_block_2, level=watch_2, Pipetype=code_block_3, Lines=byStartPointEndPoint)  # contact: cocminhduc@gmail.com
watch_3d = Watch3D(pipeFromLine)
code_block_4 = CodeBlock(x=all_elements_of_type_2) { x.Name; }
