# Dynamo graph PlaceRooms.dyn (Dynamo 2.1.0.7500)

file_path = Filename("D:\Development\BIM\Rooms.xlsx")
file_from_path = FileObject(path=file_path)
string = StringInput("Rooms")
boolean = BoolSelector(true)
importExcel = Data.ImportExcel(file=file_from_path, sheetName=string, readAsStrings=boolean)
firstItem = List.FirstItem(list=importExcel)
watch = Watch(firstItem)
restOfItems = List.RestOfItems(list=importExcel)
code_block = CodeBlock { 0; 1; 2; 3; }
getItemAtIndex = List.GetItemAtIndex(list=restOfItems@L2, index=code_block.out1)
watch_2 = Watch(restOfItems)
getItemAtIndex_2 = List.GetItemAtIndex(list=restOfItems@L2, index=code_block.out0)
unplacedByNameAndNumber = Custom[Room.UnplacedByNameAndNumber](names=getItemAtIndex_2)  # Creates an unplaced room; unwired: numbers
getItemAtIndex_3 = List.GetItemAtIndex(list=restOfItems@L2, index=code_block.out2)
getItemAtIndex_4 = List.GetItemAtIndex(list=restOfItems@L2, index=code_block.out3)
